# Grasshopper definition line+background+topo.gh (Grasshopper 1.0.8)
# plug-ins: Human, Heron

# ----
# READ FILE
path = FilePath("E:\School\2nd term\07_skill submission\01_data analysis\dataset\gh_cleaned_venice_sentiment.csv")
file = ReadFile(File=path, PerLineParse=True)
panel = Panel(file)
cull_i = CullIndex(List=file, Indices="0", Wrap=True)
tab = Panel(",")
split = TextSplit(Text=cull_i, Separators=tab)
panel_2 = Panel(split)
item = ListItem(List=split, Index="0", Wrap=True)  # -> Item, Item1

flatten = FlattenTree(Tree=item.Item, Path="{0}")
flatten_2 = FlattenTree(Tree=item.Item1, Path="{0}")
ddtoxy = DecimalDegreesToXY(Latitude=flatten_2, Longitude=flatten)  # -> XyPoint, Transform
panel_3 = Panel(ddtoxy.XyPoint)

lat = Panel("45.434894")
# CONVERT COORDINATES
long = Panel("12.343380")
# SET ANCHOR POINT
toggle = BooleanToggle(True)
seteap = SetEarthAnchorPoint(SetEAP=toggle, Latitude=lat, Longitude=long)

# ---- group: Catalog of ESRI ArcGIS REST Basemaps
esri_arcgis_base_maps = ValueList({"World Imagery": "http://server.arcgisonline.com/ArcGIS/rest/services/World_Imagery/MapServer/export?", "World Topographic": "http://server.arcgisonline.com/ArcGIS/rest/services/World_Topo_Map/MapServer/export?", "World Physical Map": "http://server.arcgisonline.com/ArcGIS/rest/services/World_Physical_Map/MapServer/export?", "World Street Map": "http://server.arcgisonline.com/ArcGIS/rest/services/World_Street_Map/MapServer/export?", "World DeLorme Street Map": "http://server.arcgisonline.com/ArcGIS/rest/services/Specialty/DeLorme_World_Base_Map/MapServer/export?", "World Shaded Relief": "http://server.arcgisonline.com/ArcGIS/rest/services/World_Shaded_Relief/MapServer/export?", "World Terrain Base": "http://server.arcgisonline.com/ArcGIS/rest/services/World_Terrain_Base/MapServer/export?", "World Boundaries and Places": "http://server.arcgisonline.com/ArcGIS/rest/services/Reference/World_Boundaries_and_Places/MapServer/export?", "World Boundaries and Places Alt": "http://server.arcgisonline.com/ArcGIS/rest/services/Reference/World_Boundaries_and_Places_Alternate/MapServer/export?", "World Reference Overlay": "http://server.arcgisonline.com/ArcGIS/rest/services/Reference/World_Reference_Overlay/MapServer/export?", "World Transportation": "http://server.arcgisonline.com/ArcGIS/rest/services/Reference/World_Transportation/MapServer/export?", "World Light Gray Base": "http://server.arcgisonline.com/ArcGIS/rest/services/Canvas/World_Light_Gray_Base/MapServer/export?", "World Light Gray Reference": "http://server.arcgisonline.com/ArcGIS/rest/services/Canvas/World_Light_Gray_Reference/MapServer/export?", "National Geographic World": "http://services.arcgisonline.com/ArcGIS/rest/services/NatGeo_World_Map/MapServer/export?", "USA Topo Maps": "http://server.arcgisonline.com/ArcGIS/rest/services/USA_Topo_Maps/MapServer/export?"}, selected="World Light Gray Base")

# ---- group: Not all imagery available at each resolution
resolution = ValueList({"None": , "Low": 256, "Med": 512, "High": 1024, "Max": 2048}, selected="Max")

# ---- group: Boundary Curve
# DO BACKGROUND IMAGE
geo = Geometry(<curve referenced from the Rhino model>)

# ---- group: USGS Raster Maps
usgs = ValueList({"Ortho 1 Foot Imagery": "http://raster.nationalmap.gov/arcgis/rest/services/Orthoimagery/USGS_EROS_Ortho_1Foot/ImageServer/exportImage?", "Ortho Imagery": "http://raster.nationalmap.gov/arcgis/rest/services/Orthoimagery/USGS_EROS_Ortho/ImageServer/exportImage?", "NAIP Imagery": "http://raster.nationalmap.gov/arcgis/rest/services/Orthoimagery/USGS_EROS_Ortho_NAIP/ImageServer/exportImage?", "Land Cover": "http://raster.nationalmap.gov/arcgis/rest/services/LandCover/USGS_EROS_LandCover_NLCD/MapServer/export?", "Land Cover - Conus 01": "http://raster.nationalmap.gov/arcgis/rest/services/LandCover/conus_01/MapServer/export?", "Land Cover - Conus 06": "http://raster.nationalmap.gov/arcgis/rest/services/LandCover/conus_06/MapServer/export?", "Land Cover - Development": "http://raster.nationalmap.gov/arcgis/rest/services/LandCover/Development_0106/MapServer/export?", "Land Cover - Wetland": "http://raster.nationalmap.gov/arcgis/rest/services/LandCover/Wetland_0106/MapServer/export?", "Topo - Scanned Maps": "http://raster.nationalmap.gov/arcgis/rest/services/Scanned_Maps/USGS_EROS_DRG_SCALE/ImageServer/exportImage?"}, selected="Ortho 1 Foot Imagery")

# ----
folder_location_for_images = Panel("E:\School\2nd term\07_skill submission\01_data analysis\rihno\temp")
image_prefix = Panel("aerial")
restraster = GetRESTRaster(
    Boundary=geo,
    Resolution=resolution,
    TargetFolder=folder_location_for_images,
    Prefix=image_prefix,
    RESTURL=esri_arcgis_base_maps,
    ImageType="jpg",
    Run=Button())  # -> Image, ImageFrame, RESTQuery
panel_4 = Panel(esri_arcgis_base_maps)

lat_2 = Panel("12.3729")
long_2 = Panel("45.4503")
lat_3 = Panel("12.3139")
long_3 = Panel("45.4195")
ddtoxy_2 = DecimalDegreesToXY(Latitude=long_2, Longitude=lat_2)  # -> XyPoint, Transform
ddtoxy_3 = DecimalDegreesToXY(Latitude=long_3, Longitude=lat_3)  # -> XyPoint, Transform

panel_5 = Panel(restraster.Image)

item_2 = ListItem(List=split, Index="5", Wrap=True)
multiplication = Multiplication(A=item_2, B=Slider(1000, range=0..1000))
Z = UnitZ(Factor=multiplication)
move = Move(Geometry=flatten(ddtoxy.XyPoint), Motion=flatten(Z))  # -> Geometry, Transform
ln = Line(StartPoint=move.Geometry, EndPoint=ddtoxy.XyPoint)
pipe = Pipe(Curve=ln, Radius=Slider(1, range=0..10), Caps=Slider(2, range=0..10), FitRail=False)
gradient = Gradient(
    LowerLimit=0,
    UpperLimit=1,
    Parameter=item_2,
    stops=[0: RGB(75, 107, 169), 0.354: RGB(173, 203, 249), 0.5: RGB(254, 244, 84), 0.652: RGB(234, 126, 0), 1: RGB(234, 38, 0)])
preview = CustomPreview(Geometry=pipe, Material=gradient)
createatts = CreateAttributes(LayerName="line", Color=gradient, enableFullPath=False)
bake = BakeGeometry(Bake=Button(), Geometry=pipe, Attributes=createatts, DeleteOldBakes=False, PreserveTrees=False)

xy_plane = XYPlane(Origin=Point(0, 0, 0))
bounding_box = BoundingBox(Content=flatten(ddtoxy.XyPoint), Plane=xy_plane, UnionBox=True)  # -> Box, Box_2
deconstruct_box = DeconstructBox(Box=bounding_box.Box)  # -> Plane, X, Y, Z
deconstruct_domain = DeconstructDomain(Domain=deconstruct_box.X)  # -> Start, End
deconstruct_domain_2 = DeconstructDomain(Domain=deconstruct_box.Y)  # -> Start, End
construct_point = ConstructPoint(XCoordinate=deconstruct_domain.Start, YCoordinate=deconstruct_domain_2.Start, ZCoordinate=0)
subtraction = Subtraction(A=deconstruct_domain.End, B=deconstruct_domain.Start)
subtraction_2 = Subtraction(A=deconstruct_domain_2.End, B=deconstruct_domain_2.Start)
construct_plane = ConstructPlane(Origin=construct_point, XAxis=Vector(1, 0, 0), YAxis=Vector(0, 1, 0))

number_slider = Slider(150, range=0..1000)
point = Point([<point referenced from the Rhino model> x781])

division = Division(A=subtraction, B=number_slider)
division_2 = Division(A=subtraction_2, B=number_slider)
round = Round(Number=division)  # -> Nearest, Floor, Ceiling
round_2 = Round(Number=division_2)  # -> Nearest, Floor, Ceiling

# ---- group: Inclusion
sqgrid = Square(Plane=construct_plane, Size=number_slider, ExtentX=round.Ceiling, ExtentY=round_2.Ceiling)  # -> flatten(Cells), Points
area = Area(Geometry=sqgrid.Cells)  # -> Area, Centroid
merge = Merge(Data1=point, Data2=area.Centroid)
pt = Point(merge)
incurves = PointInCurves(Point=pt, Curves=sqgrid.Cells)  # -> Relationship, Index, Point

# ---- group: Check all cells
multiplication_2 = Multiplication(A=round.Ceiling, B=round_2.Ceiling)
series = Series(Start=0, Step=1, Count=multiplication_2)  # -> simplify(graft(Series))
equals = Equality(FirstNumber=incurves.Index, SecondNumber=series)  # -> Equality, Inequality
cull = CullPattern(List=pt, CullPattern=equals.Equality)
panel_6 = Panel(cull)

# ----
panel_7 = Panel(incurves.Index)
tstat = TreeStatistics(Tree=cull)  # -> Paths, Length, Count

# ---- group: Check one cell
equals_2 = Equality(FirstNumber=incurves.Index, SecondNumber="12")  # -> Equality, Inequality
cull_2 = CullPattern(List=pt, CullPattern=equals_2.Equality)
panel_8 = Panel(cull_2)

# ---- group: Surface Grid
bnd = Bounds(Numbers=flatten(tstat.Length))
dom = ConstructDomain(DomainStart="0", DomainEnd="10")
remap = RemapNumbers(Value=tstat.Length, Source=bnd, Target=dom)  # -> Mapped, Clipped
Z_2 = UnitZ(Factor=remap.Mapped)

# ----
multiplication_3 = Multiplication(A=Z_2, B=Slider(500, range=0..1000))

# ---- group: Surface Grid (continued)
move_2 = Move(Geometry=area.Centroid, Motion=multiplication_3)  # -> Geometry, Transform
srfgrid = SurfaceFromPoints(Points=move_2.Geometry, UCount=round.Ceiling, Interpolate=False)

# ---- group: Graphics & Baking
contour = Contour(Shape=srfgrid, Point=Point(0, 0, 0), Direction=Vector(0, 0, 1), Distance=Slider(30, range=0..100))
eval = EvaluateCurve(Curve=contour, Parameter=0)  # -> Point, Tangent, Angle
pdecon = Deconstruct(Point=eval.Point)  # -> XComponent, YComponent, ZComponent
bnd_2 = Bounds(Numbers=flatten(pdecon.ZComponent))
dedomain = DeconstructDomain(Domain=bnd_2)  # -> Start, End
gradient_2 = Gradient(
    LowerLimit=dedomain.Start,
    UpperLimit=dedomain.End,
    Parameter=flatten(pdecon.ZComponent),
    stops=[0: RGB(75, 107, 169), 0.218: RGB(173, 203, 249), 0.28: RGB(254, 244, 84), 0.388: RGB(234, 126, 0), 1: RGB(234, 38, 0)])
preview_2 = CustomPreview(Geometry=flatten(contour), Material=gradient_2)
createatts_2 = CreateAttributes(LayerName="Topo", Color=gradient_2, enableFullPath=False)
bake_2 = BakeGeometry(Bake=Button(), Geometry=flatten(contour), Attributes=createatts_2, DeleteOldBakes=False, PreserveTrees=False)
