# Grasshopper definition data.gh (Grasshopper 1.0.8)
# plug-ins: Human, Heron

lat = Panel("45.434894")
long = Panel("12.343380")
seteap = SetEarthAnchorPoint(SetEAP=Toggle(True), Latitude=lat, Longitude=long)

path = FilePath("E:\School\2nd term\07_skill submission\RC15-25217148\02_device\device data\gh_features_gsr_only_002.csv")
file = ReadFile(File=path, PerLineParse=True)
panel = Panel(file)
cull_i = CullIndex(List=file, Indices="0", Wrap=True)
tab = Panel(",")
split = TextSplit(Text=cull_i, Separators=tab)
panel_2 = Panel(split)
item = ListItem(List=split, Index="1", Wrap=True)  # -> Item, Item1

flatten = FlattenTree(Tree=item.Item, Path="{0}")
flatten_2 = FlattenTree(Tree=item.Item1, Path="{0}")
ddtoxy = DecimalDegreesToXY(Latitude=flatten_2, Longitude=flatten)  # -> XyPoint, Transform
panel_3 = Panel(ddtoxy.XyPoint)

lat_2 = Panel("12.3729")
long_2 = Panel("45.4503")
lat_3 = Panel("12.3139")
long_3 = Panel("45.4195")
ddtoxy_2 = DecimalDegreesToXY(Latitude=long_2, Longitude=lat_2)  # -> XyPoint, Transform
ddtoxy_3 = DecimalDegreesToXY(Latitude=long_3, Longitude=lat_3)  # -> XyPoint, Transform

swatch = ColourSwatch(SwatchColor=RGB(221, 191, 119))

item_2 = ListItem(List=split, Index="3", Wrap=True)
multiplication = Multiplication(A=item_2, B=Slider(500, range=0..1000))
Z = UnitZ(Factor=multiplication)
move = Move(Geometry=flatten(ddtoxy.XyPoint), Motion=flatten(Z))  # -> Geometry, Transform
ln = Line(StartPoint=move.Geometry, EndPoint=ddtoxy.XyPoint)
pipe = Pipe(Curve=ln, Radius=Slider(1, range=0..10), Caps=Slider(2, range=0..10), FitRail=False)
preview = CustomPreview(Geometry=pipe, Material=swatch)
createatts = CreateAttributes(LayerName="Void", Color=swatch, enableFullPath=False)
bake = BakeGeometry(Bake=Button(), Geometry=pipe, Attributes=createatts, DeleteOldBakes=False, PreserveTrees=False)

swatch_2 = ColourSwatch(SwatchColor=RGB(85, 168, 104))

item_3 = ListItem(List=split, Index="4", Wrap=True)
multiplication_2 = Multiplication(A=item_3, B=Slider(500, range=0..1000))
Z_2 = UnitZ(Factor=multiplication_2)
move_2 = Move(Geometry=flatten(ddtoxy.XyPoint), Motion=flatten(Z_2))  # -> Geometry, Transform
ln_2 = Line(StartPoint=move_2.Geometry, EndPoint=ddtoxy.XyPoint)
pipe_2 = Pipe(Curve=ln_2, Radius=Slider(1, range=0..10), Caps=Slider(2, range=0..10), FitRail=False)
preview_2 = CustomPreview(Geometry=pipe_2, Material=swatch_2)
createatts_2 = CreateAttributes(LayerName="\tBio", Color=swatch_2, enableFullPath=False)
bake_2 = BakeGeometry(Bake=Button(), Geometry=pipe_2, Attributes=createatts_2, DeleteOldBakes=False, PreserveTrees=False)

swatch_3 = ColourSwatch(SwatchColor=RGB(76, 114, 176))

item_4 = ListItem(List=split, Index="5", Wrap=True)
multiplication_3 = Multiplication(A=item_4, B=Slider(500, range=0..1000))
Z_3 = UnitZ(Factor=multiplication_3)
move_3 = Move(Geometry=flatten(ddtoxy.XyPoint), Motion=flatten(Z_3))  # -> Geometry, Transform
ln_3 = Line(StartPoint=move_3.Geometry, EndPoint=ddtoxy.XyPoint)
pipe_3 = Pipe(Curve=ln_3, Radius=Slider(1, range=0..10), Caps=Slider(2, range=0..10), FitRail=False)
preview_3 = CustomPreview(Geometry=pipe_3, Material=swatch_3)
createatts_3 = CreateAttributes(LayerName="Tech", Color=swatch_3, enableFullPath=False)
bake_3 = BakeGeometry(Bake=Button(), Geometry=pipe_3, Attributes=createatts_3, DeleteOldBakes=False, PreserveTrees=False)

swatch_4 = ColourSwatch(SwatchColor=RGB(196, 78, 82))

item_5 = ListItem(List=split, Index="6", Wrap=True)
multiplication_4 = Multiplication(A=item_5, B=Slider(500, range=0..1000))
Z_4 = UnitZ(Factor=multiplication_4)
move_4 = Move(Geometry=flatten(ddtoxy.XyPoint), Motion=flatten(Z_4))  # -> Geometry, Transform
ln_4 = Line(StartPoint=move_4.Geometry, EndPoint=ddtoxy.XyPoint)
pipe_4 = Pipe(Curve=ln_4, Radius=Slider(1, range=0..10), Caps=Slider(2, range=0..10), FitRail=False)
preview_4 = CustomPreview(Geometry=pipe_4, Material=swatch_4)
createatts_4 = CreateAttributes(LayerName="Entropy", Color=swatch_4, enableFullPath=False)
bake_4 = BakeGeometry(Bake=Button(), Geometry=pipe_4, Attributes=createatts_4, DeleteOldBakes=False, PreserveTrees=False)

swatch_5 = ColourSwatch(SwatchColor=RGB(0, 0, 0))

# ---- group: Not all imagery available at each resolution
resolution = ValueList({"None": , "Low": 256, "Med": 512, "High": 1024, "Max": 2048}, selected="Max")

# ---- group: Boundary Curve
geo = Geometry(<curve referenced from the Rhino model>)

# ---- group: USGS Raster Maps
usgs = ValueList({"Ortho 1 Foot Imagery": "http://raster.nationalmap.gov/arcgis/rest/services/Orthoimagery/USGS_EROS_Ortho_1Foot/ImageServer/exportImage?", "Ortho Imagery": "http://raster.nationalmap.gov/arcgis/rest/services/Orthoimagery/USGS_EROS_Ortho/ImageServer/exportImage?", "NAIP Imagery": "http://raster.nationalmap.gov/arcgis/rest/services/Orthoimagery/USGS_EROS_Ortho_NAIP/ImageServer/exportImage?", "Land Cover": "http://raster.nationalmap.gov/arcgis/rest/services/LandCover/USGS_EROS_LandCover_NLCD/MapServer/export?", "Land Cover - Conus 01": "http://raster.nationalmap.gov/arcgis/rest/services/LandCover/conus_01/MapServer/export?", "Land Cover - Conus 06": "http://raster.nationalmap.gov/arcgis/rest/services/LandCover/conus_06/MapServer/export?", "Land Cover - Development": "http://raster.nationalmap.gov/arcgis/rest/services/LandCover/Development_0106/MapServer/export?", "Land Cover - Wetland": "http://raster.nationalmap.gov/arcgis/rest/services/LandCover/Wetland_0106/MapServer/export?", "Topo - Scanned Maps": "http://raster.nationalmap.gov/arcgis/rest/services/Scanned_Maps/USGS_EROS_DRG_SCALE/ImageServer/exportImage?"}, selected="Ortho 1 Foot Imagery")

# ---- group: Catalog of ESRI ArcGIS REST Basemaps
esri_arcgis_base_maps = ValueList({"World Imagery": "http://server.arcgisonline.com/ArcGIS/rest/services/World_Imagery/MapServer/export?", "World Topographic": "http://server.arcgisonline.com/ArcGIS/rest/services/World_Topo_Map/MapServer/export?", "World Physical Map": "http://server.arcgisonline.com/ArcGIS/rest/services/World_Physical_Map/MapServer/export?", "World Street Map": "http://server.arcgisonline.com/ArcGIS/rest/services/World_Street_Map/MapServer/export?", "World DeLorme Street Map": "http://server.arcgisonline.com/ArcGIS/rest/services/Specialty/DeLorme_World_Base_Map/MapServer/export?", "World Shaded Relief": "http://server.arcgisonline.com/ArcGIS/rest/services/World_Shaded_Relief/MapServer/export?", "World Terrain Base": "http://server.arcgisonline.com/ArcGIS/rest/services/World_Terrain_Base/MapServer/export?", "World Boundaries and Places": "http://server.arcgisonline.com/ArcGIS/rest/services/Reference/World_Boundaries_and_Places/MapServer/export?", "World Boundaries and Places Alt": "http://server.arcgisonline.com/ArcGIS/rest/services/Reference/World_Boundaries_and_Places_Alternate/MapServer/export?", "World Reference Overlay": "http://server.arcgisonline.com/ArcGIS/rest/services/Reference/World_Reference_Overlay/MapServer/export?", "World Transportation": "http://server.arcgisonline.com/ArcGIS/rest/services/Reference/World_Transportation/MapServer/export?", "World Light Gray Base": "http://server.arcgisonline.com/ArcGIS/rest/services/Canvas/World_Light_Gray_Base/MapServer/export?", "World Light Gray Reference": "http://server.arcgisonline.com/ArcGIS/rest/services/Canvas/World_Light_Gray_Reference/MapServer/export?", "National Geographic World": "http://services.arcgisonline.com/ArcGIS/rest/services/NatGeo_World_Map/MapServer/export?", "USA Topo Maps": "http://server.arcgisonline.com/ArcGIS/rest/services/USA_Topo_Maps/MapServer/export?"}, selected="World Light Gray Base")

# ----
folder_location_for_images = Panel("E:\School\2nd term\07_skill submission\01_data analysis\rihno\temp")
image_prefix = Panel("aerial")
restraster = GetRESTRaster(
    Boundary=geo,
    Resolution=resolution,
    TargetFolder=folder_location_for_images,
    Prefix=image_prefix,
    RESTURL=esri_arcgis_base_maps,
    ImageType="jpg",
    Run=Button())  # -> Image, ImageFrame, RESTQuery
panel_4 = Panel(esri_arcgis_base_maps)

panel_5 = Panel(restraster.Image)

item_6 = ListItem(List=split, Index="7", Wrap=True)
multiplication_5 = Multiplication(A=item_6)
Z_5 = UnitZ(Factor=multiplication_5)
move_5 = Move(Geometry=flatten(ddtoxy.XyPoint), Motion=flatten(Z_5))  # -> Geometry, Transform
ln_5 = Line(StartPoint=move_5.Geometry, EndPoint=ddtoxy.XyPoint)
number_slider = Slider(2, range=0..10)
number_slider_2 = Slider(2, range=0..10)
createatts_5 = CreateAttributes(LayerName="GSR", Color=swatch_5, enableFullPath=False)

pline = PolyLine(Vertices=move_5.Geometry, Closed=False)

pipe_5 = Pipe(Curve=pline, Radius=number_slider, Caps=number_slider_2, FitRail=False)
preview_5 = CustomPreview(Geometry=pipe_5, Material=swatch_5)
bake_5 = BakeGeometry(Bake=Button(), Geometry=pipe_5, Attributes=createatts_5, DeleteOldBakes=False, PreserveTrees=False)

pipe_6 = Pipe(Curve=ln_5, Radius=number_slider, Caps=number_slider_2, FitRail=False)
gradient = Gradient(
    LowerLimit=0,
    UpperLimit=1,
    Parameter=item_6,
    stops=[0: RGB(75, 107, 169), 0.637: RGB(173, 203, 249), 0.719: RGB(254, 244, 84), 0.795: RGB(234, 126, 0), 1: RGB(234, 38, 0)])
preview_6 = CustomPreview(Geometry=pipe_6, Material=gradient)
createatts_6 = CreateAttributes(LayerName="GSR", Color=gradient, enableFullPath=False)
bake_6 = BakeGeometry(Bake=Button(), Geometry=pipe_6, Attributes=createatts_6, DeleteOldBakes=False, PreserveTrees=False)
